# Grasshopper definition 32_VP_Dim All.gh (Grasshopper 1.0.8)
# plug-ins: treesloth01, Pufferfish, Rhino.Inside for Autodesk Revit, MetaHopper, eleFront

doubleclick = BooleanToggle(False)
dss_annotation_panel = Panel("Help on WhiteWork")
# Segment
# group modules into larger coherent parts
# User Interface: I/O
dss_log_v5_2 = PythonScript(Help=doubleclick)  # inputs Help: Boolean
# ---------- dss_log_v5_2: Python ----------
"""
Set grasshopper template and provide easy acces to Help file in intranet

"""

"""
Credits:
    20211117
    Created by Vladimir Ondejcik
    White arkitekter AB

Based on:
    WOMBAT version <0.0.1>
    Script by <Brian Ringley>
        def libraries() by <Giulio Piacentino> see <http://www.grasshopper3d.com/forum/topics/gh-filename-is-python>
        def writeToFile() by <Data Analytics Society> see <https://www.youtube.com/watch?v=-TF3mXhnCDw>
    Script version <15 September 2015> 
    Copyright <Creative Commons Sharealike>
"""


#add dsearch default path located on cad.local
import sys
new_path = r"\\sesthfs02\DSEARCH\REPOSITORY\Grasshopper\Xtras\DsearchCode"
if new_path not in sys.path: sys.path.append(new_path)

#import dsearch plugin
import dsearch as ds

import os

print sys.path

#reload module (this has use when working on module)
#reload(ds.DS_Log)
#reload(ds.DS_Links)

#setup template
template=ds.DS_Links.Template
ds.DS_Log.DS_Template(template)

#run help from module 
if Help:
    helpLink=ds.DS_Links.HelpLink
    ds.DS_Log.DS_Help(helpLink)

    #turn toggle back to false
    obj=ghenv.Component.Params.Input[0].Sources[0]
    obj.Value=False
    obj.ExpireSolution(True)
# ---------- end dss_log_v5_2 ----------

dss_projectnumber = Panel("0000")
dss_projectname = Panel("name")

# ----
# Organization of Grasshopper scripts at White:
# Script should be created and annotated always with notion that other person will need to use/edit them.
# Build your script in modules and segments, use color coding and annotation according this template.
# This standard should be applied to all scripts, big or small.
# 
# Read  guide on white work:
# "https://work.white.se/grasshopper-developer-guide/"
# For Advanced users:
# For design scripts running more than a month use "dsInitialize" and "dsScriptLog" functions on Dsearch tab to log changes over time.
dss_annotation_panel_2 = Panel("""Tip of a day:
You can change default colour grups by right clicking
Graphical templates are located on "Dsearch" tab""")
# GRAPHIC
# STANDARD
# In
# data and geometry import from rhino or external platforms
image = ImageSampler(dss_annotation_panel_2, Filter="Colour", Interpolate=False, Umax=1, Umin=0, Vmax=1, Vmin=0, Wrap=0)

categories_to_create_annotation_objects = Panel("""Plumbing Fixtures
Casework
Furniture
Electrical Equipment""")  # "Categories to create annotation objects to"

# ---- group: Dimension
onoff = EnableDisableObject(Enabled=Button(), AllObjects_Object=[add_aligned_dimension_2, add_aligned_dimension])

# ---- group: Offset from view frame
number_slider = Slider(300, range=0..1000)

# ----
text = Text(categories_to_create_annotation_objects)
active_selection = GraphicalElement()

# ----
# Choose Section Viewport
active_view = ActiveView()
query_viewports = QueryViewports(Sheet=active_view)
view = View(query_viewports)
element_type = ElementType(Element=view)  # -> Element, Type
cset = CreateSet(List=element_type.Type)  # -> Set, Map
value_picker = ValuePicker(cset.Set)
mindex = MemberIndex(Set=element_type.Type, Member=value_picker)  # -> Index, Count
item = ListItem(List=element_type.Element, Index=mindex.Index, Wrap=True)
value_picker_2 = ValuePicker(item)
view_2 = View(active_selection)
passport = ElementPassport(Element=view_2)  # -> DocumentGUID, Document, UniqueID, Id

# ----
# General
# Monitor
# Out
# Control
# variable parameters and script execution
# (sliders, boolean togggle, text input,...)
# monitor data and geometry preview (used for panels for example)
# output data to rhino or external platforms
# WIP
# Annotation
# Plugin
# general annotation and notes
# textbased scripting and special plugins
# f.ex: HumanUI, kangaroo,...
# problematic or under repair or construction
# Back-end
dss_annotation_panel_3 = Panel("general development modules")

dss_annotation_panel_4 = Panel(view_2)

query_categories = QueryCategories(Type=1, Name="Walls", IsVisibleUI=True, IsSubcategory=False)  # -> simplify(Categories)
query_view_elements = QueryViewElements(View=view_2, Categories=query_categories)  # -> flatten(Elements)

query_categories_2 = QueryCategories(Type=1, Name="Rooms", IsVisibleUI=True, IsSubcategory=False)  # -> simplify(Categories)
query_view_elements_2 = QueryViewElements(View=view_2, Categories=query_categories_2)  # -> flatten(Elements)

number_slider_2 = Slider(1, range=0..1)

# ----
# Vertical dimension chain
view_3 = View(simplify(graft(view_2)))

# ---- group: Planes to draw dimensions to
# Left
# Center (Left/Right)
# Right
# Front
# Center (Front/Back)
# Back
# Bottom
# Center (Elevation)
# Top
panel = Panel("""Left
Center (Left/Right)
Right""")
panel_2 = Panel("""Bottom
Center (Elevation)
Top""")

# ---- group: Planes to draw dimensions to / Horisontal dimension
z_dimension = ValuePicker(panel)

# ---- group: Planes to draw dimensions to / Vertical dimension
z_dimension_2 = ValuePicker(panel_2)

# ---- group: Planes to draw dimensions to (continued)
panel_3 = Panel(z_dimension_2)
panel_4 = Panel(z_dimension)

# ---- group: Categories to be affected
# Basic geometry for the view
txt = Text(flatten(["Plumbing Fixtures", "Casework"]))

# ----
text_2 = Text(text)
query_categories_3 = QueryCategories(Type=1, Name="Floors", IsVisibleUI=True, IsSubcategory=False)  # -> simplify(Categories)
bounding_box = BoundingBox(Content=query_view_elements_2, Plane=PlaneXY(0, 0, 0))  # -> flatten(Box), Box_2
query_view_elements_3 = QueryViewElements(View=simplify(graft(view_2)), Categories=query_categories_3)  # -> simplify(Elements)
bounding_box_filter = BoundingBoxFilter(BoundingBox=bounding_box.Box, Union=True, Strict=False, Tolerance=0, Inverted=False)  # -> Filter, Target

# ---- group: Categories to be affected (continued)
query_categories_4 = QueryCategories(Type=1, Name=text_2, IsVisibleUI=True, IsSubcategory=False)  # -> simplify(Categories)

# ----
query_view_elements_4 = QueryViewElements(View=view_2, Categories=flatten(query_categories_4), Filter=bounding_box_filter.Filter)  # -> simplify(Elements)
graphical_element = GraphicalElement(simplify(query_view_elements_4))

# ---- group: Top face of floor
item_2 = ListItem(List=query_view_elements_3, Index=0, Wrap=True)
element_references = ElementReferences(Element=item_2)  # -> Faces, Edges, Lines
md_slider = MDSlider(SliderMode=0, slider_value=Point(0.5, 0.5, 0.5), x_domain=Domain(0, 1), y_domain=Domain(0, 1), z_domain=Domain(0, 1))
srf = Surface(element_references.Faces)
evalsrf = EvaluateSurface(Surface=srf, Point=md_slider)  # -> Point, Normal, UDirection, VDirection, Frame
Z = UnitZ(Factor=1)
dprod = DotProduct(VectorA=evalsrf.Normal, VectorB=Z, Unitize=False)
equals = Equality(FirstNumber=dprod, SecondNumber="1")  # -> Equality, Inequality
cull = CullPattern(List=element_references.Faces, CullPattern=equals.Equality)  # -> simplify(List)

# ---- group: Bounding regtangle of viewport
view_4 = View(simplify(graft(view_2)))
pln = Plane(view_4)
brec = BoundingRectangle(Geometry=graphical_element, Plane=pln, Axis=0, Slide=0, Union=True)  # -> Bounding, DimensionX, DimensionY
pcen = PolygonCenter(Polyline=brec.Bounding)  # -> CenterV, CenterE, CenterA
pt = Point(pcen.CenterV)

# ---- group: Reference planes
text_3 = Text(panel_4)
component_reference_plane = ComponentReferencePlane(Component=graphical_element, Name=text_3)

graphical_element_2 = GraphicalElement(graphical_element)
text_4 = Text(panel_3)
component_reference_plane_2 = ComponentReferencePlane(Component=graphical_element_2, Name=text_4)
data = Data(component_reference_plane_2)
null = NullItem(Item=data)  # -> NullFlags, InvalidFlags, Description
cull_2 = CullPattern(List=data, CullPattern=invert(null.NullFlags))
clean = CleanTree(RemoveNulls=True, RemoveInvalid=True, RemoveEmpty=True, Tree=cull_2)
data_2 = Data(clean)

# ---- group: Top face of floor
data_3 = Data(simplify(cull))

# ---- group: Adjust so it compares right direction
data_4 = Data(component_reference_plane)
null_2 = NullItem(Item=data_4)  # -> NullFlags, InvalidFlags, Description
cull_3 = CullPattern(List=data_4, CullPattern=invert(null_2.NullFlags))
clean_2 = CleanTree(RemoveNulls=True, RemoveInvalid=True, RemoveEmpty=True, Tree=cull_3)

# ---- group: Adjust so it compares right direction / Removes ref planes facing the wrong way
view_5 = View(simplify(graft(view_2)))
face = Face(clean_2)
plane = Plane(face)
plane_2 = Plane(view_5)
deconstruct_plane = DeconstructPlane(Plane=plane)  # -> Origin, XAxis, YAxis, ZAxis
deconstruct_plane_2 = DeconstructPlane(Plane=plane_2)  # -> Origin, XAxis, YAxis, ZAxis
dot_product = DotProduct(VectorA=deconstruct_plane.ZAxis, VectorB=deconstruct_plane_2.ZAxis, Unitize=False)
round = Round(Number=dot_product)  # -> Nearest, Floor, Ceiling
boolean = Boolean(round.Nearest)

# ----
cull_pattern = CullPattern(List=face, CullPattern=invert(boolean))

# ---- group: Adjust so it compares right direction (continued)
element_location = ElementLocation(Element=cull_pattern)  # -> Element, Location, Hand, Facing, WorkPlane

# ---- group: Vertical dimensions
rectangle = Rectangle(simplify(view_4))
Z_2 = UnitZ(Factor=1)

# ---- group: Vertical dimensions / View frame
crv = Curve(rectangle)

# ---- group: Vertical dimensions (continued)
offset = OffsetCurve(Curve=crv, Distance=number_slider, Corners=1)  # -> simplify(Curve)
explode = Explode(Curve=offset, Recursive=True)  # -> Segments, Vertices
dprod_2 = DotProduct(VectorA=explode.Segments, VectorB=Z_2, Unitize=False)
bool = Boolean(dprod_2)
cull_4 = CullPattern(List=explode.Segments, CullPattern=bool)
crv_cp = CurveClosestPoint(Point=pt, Curve=cull_4)  # -> Point, Parameter, Distance
sort = SortList(Keys=crv_cp.Distance, ValuesA=cull_4)  # -> Keys, simplify(ValuesA)

# ---- group: Horizontal dimensions
cull_5 = CullPattern(List=explode.Segments, CullPattern=invert(bool))
pt_2 = Point(pcen.CenterV)
crv_cp_2 = CurveClosestPoint(Point=pt_2, Curve=cull_5)  # -> Point, Parameter, Distance
sort_2 = SortList(Keys=crv_cp_2.Distance, ValuesA=cull_5)  # -> Keys, ValuesA
item_3 = ListItem(List=sort_2.ValuesA, Index=0, Wrap=True)  # -> simplify(Item)

# ---- group: Wall face
Z_3 = UnitZ(Factor=1)
line = Line(query_view_elements)
xprod = CrossProduct(VectorA=item_3, VectorB=Z_3, Unitize=False)  # -> Vector, Length
dprod_3 = DotProduct(VectorA=unitize(xprod.Vector), VectorB=unitize(line), Unitize=False)
bool_2 = Boolean(dprod_3)
cull_6 = CullPattern(List=query_view_elements, CullPattern=bool_2)
element_references_2 = ElementReferences(Element=cull_6)  # -> simplify(Faces), Edges, Lines
md_slider_2 = MDSlider(SliderMode=0, slider_value=Point(0.5, 0.5, 0.5), x_domain=Domain(0, 1), y_domain=Domain(0, 1), z_domain=Domain(0, 1))
srf_2 = Surface(element_references_2.Faces)
evalsrf_2 = EvaluateSurface(Surface=srf_2, Point=md_slider_2)  # -> Point, Normal, UDirection, VDirection, Frame
Z_4 = UnitZ(Factor=1)
dprod_4 = DotProduct(VectorA=evalsrf_2.Normal, VectorB=unitize(item_3), Unitize=False)
equals_2 = Equality(FirstNumber=dprod_4, SecondNumber="1")  # -> Equality, Inequality
cull_7 = CullPattern(List=element_references_2.Faces, CullPattern=dprod_4)  # -> simplify(List)
project = Project(Geometry=simplify(pt_2), Plane=cull_7)  # -> simplify(Geometry), simplify(Transform)
cluster = Cluster(data=cull_7)
cluster_2 = Cluster(data=project.Geometry)
ln = Line(StartPoint=simplify(pt_2), EndPoint=cluster_2)  # -> simplify(Line)
cluster_3 = Cluster(data=ln)
len = Length(Curve=cluster_3)
sort_3 = SortList(Keys=len, ValuesA=cluster)  # -> Keys, ValuesA
item_4 = ListItem(List=sort_3.ValuesA, Index=0, Wrap=True)

# ---- group: Remove duplicate dimensions
curve = Curve(item_3)
point = Point(element_location.Location)
curve_closest_point = CurveClosestPoint(Point=simplify(point), Curve=reparameterize(curve))  # -> simplify(Point), simplify(Parameter), simplify(Distance)
cull_duplicates = CullDuplicates(Points=curve_closest_point.Point, Tolerance=0.1, CullMode=3)  # -> Points, simplify(Indices), Valence
list_item = ListItem(List=cull_pattern, Index=cull_duplicates.Indices, Wrap=True)

# ---- group: Ugly way of finding closest point
view_6 = View(simplify(graft(view_2)))
element_location_2 = ElementLocation(Element=data_2)  # -> Element, Location, Hand, Facing, WorkPlane
plane_3 = Plane(view_6)
curve_2 = Curve(reparameterize(sort.ValuesA))
number_slider_3 = Slider(1, range=0..1)
project_2 = Project(Geometry=element_location_2.Location, Plane=plane_3)  # -> Geometry, Transform
project_3 = Project(Geometry=element_location_2.Location, Plane=plane_3)  # -> Geometry, Transform
list_item_2 = ListItem(List=curve_2, Index="0", Wrap=True)
list_item_3 = ListItem(List=curve_2, Index="1", Wrap=True)
curve_closest_point_2 = CurveClosestPoint(Point=simplify(project_2.Geometry), Curve=simplify(list_item_2))  # -> simplify(Point), Parameter, simplify(Distance)
curve_closest_point_3 = CurveClosestPoint(Point=simplify(project_3.Geometry), Curve=simplify(list_item_3))  # -> simplify(Point), Parameter, simplify(Distance)
number = Number(simplify(graft(curve_closest_point_2.Distance)))
list_length = ListLength(List=number)
list_length_2 = ListLength(List=number)
number_2 = Number(simplify(graft(curve_closest_point_3.Distance)))
duplicate_data = DuplicateData(Data="0", Number=list_length, Order=True)
merge = Merge(Data1=number, Data2=number_2)  # -> simplify(Result)
duplicate_data_2 = DuplicateData(Data="1", Number=list_length_2, Order=True)
merge_2 = Merge(Data1=duplicate_data, Data2=duplicate_data_2)  # -> simplify(Result)
sort_list = SortList(Keys=merge, ValuesValuesA=merge_2)  # -> Keys, ValuesValuesA
list_item_4 = ListItem(List=sort_list.ValuesValuesA, Index=0, Wrap=True)
cluster_4 = Cluster(data=list_item_4)

# ----
renumber_paths = RenumberPaths(Data=list_item)

# ----
# Horizontal dimension chain
view_7 = View(view_2)
item_5 = ListItem(List=item_3, Index="1", Wrap=True)

list_length_3 = ListLength(List=view_7)
smaller_than = SmallerThan(FirstNumber=list_length_3, SecondNumber="1")  # -> SmallerThan, OrEqualTo
stream_filter = StreamFilter(Gate=smaller_than.OrEqualTo, Stream0=item_4, Stream1=flatten(item_4))
view_8 = View(simplify(graft(view_7)))
data_5 = Data([stream_filter, renumber_paths])

# ---- group: Putting references in right order
element_location_3 = ElementLocation(Element=data_5)  # -> Element, Location, Hand, Facing, WorkPlane
curve_3 = Curve(item_3)
curve_closest_point_4 = CurveClosestPoint(Point=simplify(element_location_3.Location), Curve=reparameterize(curve_3))  # -> simplify(Point), simplify(Parameter), simplify(Distance)
sort_list_2 = SortList(Keys=simplify(curve_closest_point_4.Parameter), ValuesValuesA=simplify(data_5))  # -> Keys, simplify(ValuesValuesA)

# ----
add_aligned_dimension = AddAlignedDimension(View=view_8, References=sort_list_2.ValuesValuesA, Line=item_5, FailureProcessingMode=1)  # disabled

tree_statistics = TreeStatistics(Tree=cluster_4)  # -> Paths, Length, Count
list_item_5 = ListItem(List=curve_2, Index=cluster_4, Wrap=True)  # -> simplify(graft(Item))
replace_text = ReplaceText(Text=tree_statistics.Paths, Find="}", Replace=";", RecursiveReplace=False)
concatenate = Concatenate(Fragment_A=simplify(graft(replace_text)), Fragment_B=cluster_4, A="}")
create_tree = CreateTree(Data=flatten(data_2), Path=concatenate)
create_tree_2 = CreateTree(Data=flatten(list_item_5), Path=concatenate)
list_item_6 = ListItem(List=create_tree_2, Index=0, Wrap=True)

# ---- group: Floor
renumber_paths_2 = RenumberPaths(Data=data_3)
list_length_4 = ListLength(List=data_2)
duplicate_data_3 = DuplicateData(Data=renumber_paths_2, Number=list_length_4, Order=True)  # -> simplify(Data)
create_tree_3 = CreateTree(Data=flatten(duplicate_data_3), Path=concatenate)  # -> simplify(Data)
list_item_7 = ListItem(List=create_tree_3, Index=0, Wrap=True)

# ----
data_6 = Data([create_tree, list_item_7])
tree_statistics_2 = TreeStatistics(Tree=data_6)  # -> Paths, Length, Count

tree_statistics_3 = TreeStatistics(Tree=list_item_6)  # -> Paths, Length, Count
text_split = TextSplit(Text=tree_statistics_3.Paths, Separators=";")
replace_text_2 = ReplaceText(Text=";", Find="}", Replace="}", RecursiveReplace=False)
list_item_8 = ListItem(List=text_split, Index=0, Wrap=True)
concatenate_2 = Concatenate(FragmentA=list_item_8, FragmentB="}")
tree_branch = TreeBranch(Tree=view_3, Path=concatenate_2, MaintainPaths=True)  # -> graft(Branch)

# ---- group: Putting references in right order
element_location_4 = ElementLocation(Element=data_6)  # -> Element, Location, Hand, Facing, WorkPlane
curve_4 = Curve(list_item_6)
curve_closest_point_5 = CurveClosestPoint(Point=simplify(element_location_4.Location), Curve=reparameterize(curve_4))  # -> simplify(Point), simplify(Parameter), simplify(Distance)
sort_list_3 = SortList(Keys=simplify(curve_closest_point_5.Parameter), ValuesValuesA=simplify(data_6))  # -> Keys, simplify(ValuesValuesA)

# ---- group: Seperate path for only one viewport
create_tree_4 = CreateTree(Data=duplicate_data_3, Path=flatten(list_item_4))
create_tree_5 = CreateTree(Data=data_2, Path=flatten(list_item_4))
view_9 = View(simplify(graft(view_2)))
list_length_5 = ListLength(List=flatten(view_9))
subtraction = Subtraction(A=list_length_5, B="1")
list_item_9 = ListItem(List=create_tree_4, Index=0, Wrap=True)
boolean_2 = Boolean(subtraction)

# ----
stream_filter_2 = StreamFilter(Gate=boolean_2, Stream0=[create_tree_5, list_item_9], Stream1=sort_list_3.ValuesValuesA)
renumber_paths_3 = RenumberPaths(Data=stream_filter_2)
stream_filter_3 = StreamFilter(Gate=boolean_2, Stream0=curve_2, Stream1=list_item_6)  # -> simplify(graft(Stream))
stream_filter_4 = StreamFilter(Gate=boolean_2, Stream0=view_9, Stream1=tree_branch)  # -> simplify(Stream)
add_aligned_dimension_2 = AddAlignedDimension(View=stream_filter_4, References=renumber_paths_3, Line=stream_filter_3)  # disabled

# ==== cluster Cluster
data = ClusterInput()

# ---- group: Tree to main index
data_2 = Data(data)
clean = CleanTree(RemoveNulls=True, RemoveInvalid=True, RemoveEmpty=True, Tree=data_2)
data_3 = Data(clean)

# ---- group: Tree to main index / Gets main index from path
tstat = TreeStatistics(Tree=clean)  # -> Paths, Length, Count
split = TextSplit(Text=tstat.Paths, Separators=";")  # -> simplify(Result)
item = ListItem(List=split, Index=0, Wrap=True)
concat = Concatenate(FragmentA=item, FragmentB="}")
rep = ReplaceText(Text=concat, Find="}}", Replace="}", RecursiveReplace=False)
dup = DuplicateData(Data=rep, Number=simplify(graft(tstat.Length)), Order=True)  # -> flatten(Data)

# ---- group: Tree to main index (continued)
tree = CreateTree(Data=data_3, Path=dup)
data_4 = Data(tree)

# ----
data_5 = ClusterOutput(data_4)
